# Grasshopper definition transform_revit_ecs_to_epsg-p2326-v5738.gh (Grasshopper 1.0.8)
# Copyright: Arup
# plug-ins: eleFront, Speckle.Connector.Grasshopper

speckle_model = SpeckleModel(
    Model="7f2a89be04",
    Project="34b188cb10",
    Server="https://app.speckle.systems",
    User="80EEB7BBE4744244BEF9F42A8D144D75",
    Workspace="b6415b8ed6")
speckle_model_2 = SpeckleModel(
    Model="55ab2430e5",
    Project="34b188cb10",
    Server="https://app.speckle.systems",
    User="80EEB7BBE4744244BEF9F42A8D144D75",
    Workspace="b6415b8ed6")
load = Load(SpeckleModel=speckle_model, AutoReceive=False)  # -> Collection, Properties
load_2 = Load(SpeckleModel=speckle_model_2, AutoReceive=False)  # -> Collection, Properties
revit_advanced_sample_arch_spklcollectio = EleFrontDataDescription(load.Collection, ShiftDepth=0, isNameSet=True)  # "Revit Advanced Sample Arch_SpklCollection"
revit_advanced_sample_str_spklcollection = EleFrontDataDescription(load_2.Collection, ShiftDepth=0, isNameSet=True)
collection_selector = CollectionSelector(revit_advanced_sample_str_spklcollection, AutoSelectAllItems=False)
panel = Panel("advanced_sample_project_arch::advanced_sample_project_arch::")
panel_2 = Panel("""Roof
Parapet::Roofs""")
panel_3 = Panel("""No Level
01 - Entry Level
02 - Floor
03 - Floor""")
revit_advanced_sample_str_spklcollection_2 = EleFrontDataDescription(revit_advanced_sample_str_spklcollection, ShiftDepth=0, isNameSet=True)
revit_advanced_sample_arch_spklcollectio_2 = EleFrontDataDescription(revit_advanced_sample_arch_spklcollectio, ShiftDepth=0, isNameSet=False)  # "Revit Advanced Sample Arch_SpklCollection"
concatenate = Concatenate(FragmentA=panel, FragmentB=panel_3)
concatenate_2 = Concatenate(FragmentA=panel, FragmentB=panel_2)
query_speckle_objects = QuerySpeckleObjects(Collection=revit_advanced_sample_arch_spklcollectio_2, Path=concatenate)
query_speckle_objects_2 = QuerySpeckleObjects(Collection=revit_advanced_sample_arch_spklcollectio_2, Path=concatenate_2)
query_speckle_objects_3 = QuerySpeckleObjects(Collection=revit_advanced_sample_str_spklcollection_2, Path=collection_selector)  # -> Objects, InstanceReference, Points, PointClouds, Curves, Extrusions, Breps, SubDs, Meshes, Hatches
explode_tree = ExplodeTree(Data=query_speckle_objects)  # -> Branch0, Branch1, Branch2, Branch3
speckle_data_object = SpeckleDataObject(flatten(query_speckle_objects_2))
speckle_data_object_2 = SpeckleDataObject(flatten(query_speckle_objects_3.Objects))
easting = Slider(838809.3, range=838780..838840)
northing = Slider(819822.3, range=819785..819845)
height = Slider(6.6, range=0..10)
rotation = Slider(136, range=0..360)
_01_entry_level_sdo = EleFrontDataDescription(explode_tree.Branch1, ShiftDepth=0, isNameSet=True)
foundation_sdo = EleFrontDataDescription(speckle_data_object_2, ShiftDepth=0, isNameSet=True)
_02_floor_sdo = EleFrontDataDescription(explode_tree.Branch2, ShiftDepth=0, isNameSet=True)
_03_floor_sdo = EleFrontDataDescription(explode_tree.Branch3, ShiftDepth=0, isNameSet=True)
no_level_sdo = EleFrontDataDescription(explode_tree.Branch0, ShiftDepth=0, isNameSet=True)
roof_sdo = EleFrontDataDescription(speckle_data_object, ShiftDepth=0, isNameSet=True)
vector_xyz = VectorXYZ(XComponent=easting, YComponent=northing, ZComponent=height)  # -> Vector, Length
radians = Radians(Degrees=rotation)
xy_plane = XYPlane(Origin=Point(0, 0, 0))
foundation_sdo_2 = EleFrontDataDescription(foundation_sdo, ShiftDepth=0, isNameSet=False)
no_level_sdo_2 = EleFrontDataDescription(no_level_sdo, ShiftDepth=0, isNameSet=False)
_01_entry_level_sdo_2 = EleFrontDataDescription(_01_entry_level_sdo, ShiftDepth=0, isNameSet=False)
_02_floor_sdo_2 = EleFrontDataDescription(_02_floor_sdo, ShiftDepth=0, isNameSet=False)
_03_floor_sdo_2 = EleFrontDataDescription(_03_floor_sdo, ShiftDepth=0, isNameSet=False)
roof_sdo_2 = EleFrontDataDescription(roof_sdo, ShiftDepth=0, isNameSet=False)
move = Move(Motion=vector_xyz.Vector)  # -> Geometry, Transform
rotate = Rotate(Angle=radians, Plane=xy_plane)  # -> Geometry, Transform
entwine = Entwine(
    Branch00=foundation_sdo_2,
    Branch01=no_level_sdo_2,
    Branch02=_01_entry_level_sdo_2,
    Branch03=_02_floor_sdo_2,
    Branch04=_03_floor_sdo_2,
    Branch05=roof_sdo_2,
    FlattenInputs=True)
suirify = Suirify(entwine)
merge = Merge(Data1=rotate.Transform, Data2=move.Transform)
arch_foundation_sdo = EleFrontDataDescription(suirify, ShiftDepth=0, isNameSet=True)
compound = Compound(Transforms=merge)
speckle_data_object_3 = SpeckleDataObject(SpeckleDataObject=arch_foundation_sdo)  # -> SpeckleDataObject, Geometries, Name, Properties, Path
transform = Transform(compound)
trim_tree = TrimTree(Tree=speckle_data_object_3.Geometries, Depth=1)
transform_2 = Transform(Geometry=trim_tree, Transform=transform)
tree_branch = TreeBranch(Tree=transform_2, Path=Slider(0, range=0..5), MaintainPaths=True)
speckle_data_object_4 = SpeckleDataObject(Geometries=transform_2)  # -> SpeckleDataObject, Geometries, Name, Properties, Path
explode_tree_2 = ExplodeTree(Data=speckle_data_object_4.SpeckleDataObject)  # -> Branch0, Branch1, Branch2, Branch3, Branch4, Branch5
speckle_model_3 = SpeckleModel(
    Model="721ad7b589",
    Project="dea5d61543",
    Server="https://app.speckle.systems",
    User="80EEB7BBE4744244BEF9F42A8D144D75",
    Workspace="e291c1626c")
create_collection = CreateCollection(
    Foundation=explode_tree_2.Branch0,
    NoLevel=explode_tree_2.Branch1,
    _01EntryLevel=explode_tree_2.Branch2,
    _02Floor=explode_tree_2.Branch3,
    _03Floor=explode_tree_2.Branch4,
    Roof=explode_tree_2.Branch5,
    AlwaysInheritNames=False)
publish = Publish(SpeckleModel=speckle_model_3, Collection=create_collection)
